# Dynamo graph dynamo_model_sample_app.dyn (Dynamo 2.13.1.3887)

width = IntegerSlider(6, range=4..6 step 1)  # graph input
depth = IntegerSlider(5, range=5..10 step 1)  # graph input
number_of_floors = IntegerSlider(2, range=1..5 step 1)  # graph input
height_floor = DoubleSlider(3, range=2..3 step 0.1)  # graph input
total_height = CodeBlock(n_floors=number_of_floors, height_floor=height_floor) { n_floors*height_floor; }
seperation_houses = CodeBlock(width=width, depth=depth, total_height=total_height) { x=[width/2,width/2]; y=[-depth/2,-depth/2]; z=[0,total_height]; }
byCoordinates = Point.ByCoordinates(x=seperation_houses.x, y=seperation_houses.y, z=seperation_houses.z)
byBestFitThroughPoints = Line.ByBestFitThroughPoints(bestFitPoints=byCoordinates)
number_of_houses = IntegerSlider(2, range=1..8 step 1)  # graph input
code_block = CodeBlock(n_houses=number_of_houses, width=width) { 0..(n_houses-1)*width..width; }
translate = Geometry.Translate(geometry=byBestFitThroughPoints, xTranslation=code_block)
seperation_houses_2 = CodeBlock(width=width, depth=depth, total_height=total_height) { x=[width/2,width/2]; y=[depth/2,depth/2]; z=[0,total_height]; }
byCoordinates_2 = Point.ByCoordinates(x=seperation_houses_2.x, y=seperation_houses_2.y, z=seperation_houses_2.z)
byBestFitThroughPoints_2 = Line.ByBestFitThroughPoints(bestFitPoints=byCoordinates_2)
translate_2 = Geometry.Translate(geometry=byBestFitThroughPoints_2, xTranslation=code_block)
height_roof = DoubleSlider(3, range=2..3 step 0.1)  # graph input
seperation_line_roof_back = CodeBlock(width=width, depth=depth, total_height=total_height, height_roof=height_roof) { x=[width/2,width/2]; y=[depth/2,0]; z=[total_height,total_height+height_roof]; }
byCoordinates_3 = Point.ByCoordinates(x=seperation_line_roof_back.x, y=seperation_line_roof_back.y, z=seperation_line_roof_back.z)
byBestFitThroughPoints_3 = Line.ByBestFitThroughPoints(bestFitPoints=byCoordinates_3)
translate_3 = Geometry.Translate(geometry=byBestFitThroughPoints_3, xTranslation=code_block)
seperation_line_roof_front = CodeBlock(width=width, depth=depth, total_height=total_height, height_roof=height_roof) { x=[width/2,width/2]; y=[-depth/2,0]; z=[total_height,total_height+height_roof]; }
byCoordinates_4 = Point.ByCoordinates(x=seperation_line_roof_front.x, y=seperation_line_roof_front.y, z=seperation_line_roof_front.z)
byBestFitThroughPoints_4 = Line.ByBestFitThroughPoints(bestFitPoints=byCoordinates_4)
translate_4 = Geometry.Translate(geometry=byBestFitThroughPoints_4, xTranslation=code_block)
front_door = CodeBlock(depth=depth) { x=[0,0,1,1]; y=[depth/2,depth/2,depth/2,depth/2]; z=[0,1.5,1.5,0]; }
byCoordinates_5 = Point.ByCoordinates(x=front_door.x, y=front_door.y, z=front_door.z)
byPoints = PolyCurve.ByPoints(points=byCoordinates_5)
translate_5 = Geometry.Translate(geometry=byPoints, xTranslation=code_block)
front_window = CodeBlock(depth=depth) { x=[-1.5,-1.5,-0.5,-0.5]; y=[depth/2,depth/2,depth/2,depth/2]; z=[0.7,1.5,1.5,0.7]; }
byCoordinates_6 = Point.ByCoordinates(x=front_window.x, y=front_window.y, z=front_window.z)
byCornerPoints = Rectangle.ByCornerPoints(points=byCoordinates_6)
translate_6 = Geometry.Translate(geometry=byCornerPoints, xTranslation=code_block)
back_door = CodeBlock(depth=depth) { x=[-1,-1,1,1]; y=[-depth/2,-depth/2,-depth/2,-depth/2]; z=[0,1.5,1.5,0]; }
byCoordinates_7 = Point.ByCoordinates(x=back_door.x, y=back_door.y, z=back_door.z)
byPoints_2 = PolyCurve.ByPoints(points=byCoordinates_7)
translate_7 = Geometry.Translate(geometry=byPoints_2, xTranslation=code_block)
back_door_2 = CodeBlock(depth=depth) { x=[0,0]; y=[-depth/2,-depth/2]; z=[0,1.5]; }
byCoordinates_8 = Point.ByCoordinates(x=back_door_2.x, y=back_door_2.y, z=back_door_2.z)
byPoints_3 = PolyCurve.ByPoints(points=byCoordinates_8)
translate_8 = Geometry.Translate(geometry=byPoints_3, xTranslation=code_block)
back_window_1 = CodeBlock(n_floors=number_of_floors, depth=depth, height_floor=height_floor)
# ---------- back_window_1.designscript (3 lines) ----------
x=(n_floors-1)/(n_floors-1)*[-1.5,-1.5,-0.5,-0.5];
y=(n_floors-1)/(n_floors-1)*[-depth/2,-depth/2,-depth/2,-depth/2];
z=(n_floors-1)/(n_floors-1)*height_floor+[height_floor/1.5,height_floor/3.5,height_floor/3.5,height_floor/1.5];
# ----------------------------------------
byCoordinates_9 = Point.ByCoordinates(x=back_window_1.x, y=back_window_1.y, z=back_window_1.z)
byCornerPoints_2 = Rectangle.ByCornerPoints(points=byCoordinates_9)
code_block_2 = CodeBlock(number_of_floors=number_of_floors, height_floor=height_floor) { 0..(number_of_floors-2)*height_floor..height_floor; }
translate_9 = Geometry.Translate(geometry=byCornerPoints_2, zTranslation=code_block_2)
cycle = List.Cycle(list=translate_9, amount=number_of_houses)
number_of_windows = CodeBlock(n=number_of_floors) { n-1; }
chop = List.Chop(list=cycle, lengths=number_of_windows)
translate_10 = Geometry.Translate(geometry=chop, xTranslation=code_block)
back_window_2 = CodeBlock(n_floors=number_of_floors, depth=depth, height_floor=height_floor)
# ---------- back_window_2.designscript (3 lines) ----------
x=(n_floors-1)/(n_floors-1)*[1.5,1.5,0.5,0.5];
y=(n_floors-1)/(n_floors-1)*[-depth/2,-depth/2,-depth/2,-depth/2];
z=(n_floors-1)/(n_floors-1)*height_floor+[height_floor/1.5,height_floor/3.5,height_floor/3.5,height_floor/1.5];
# ----------------------------------------
byCoordinates_10 = Point.ByCoordinates(x=back_window_2.x, y=back_window_2.y, z=back_window_2.z)
byCornerPoints_3 = Rectangle.ByCornerPoints(points=byCoordinates_10)
code_block_3 = CodeBlock(number_of_floors=number_of_floors, height_floor=height_floor) { 0..(number_of_floors-2)*height_floor..height_floor; }
translate_11 = Geometry.Translate(geometry=byCornerPoints_3, zTranslation=code_block_3)
cycle_2 = List.Cycle(list=translate_11, amount=number_of_houses)
number_of_windows_2 = CodeBlock(n=number_of_floors) { n-1; }
chop_2 = List.Chop(list=cycle_2, lengths=number_of_windows_2)
translate_12 = Geometry.Translate(geometry=chop_2, xTranslation=code_block)
floor_area_per_house = CodeBlock(length=depth, width=width, n_floors=number_of_floors) { length*width*n_floors; }
output_floor_area_per_house = Watch(floor_area_per_house)  # graph output
total_cost = CodeBlock(n_houses=number_of_houses, n_floors=number_of_floors, length=depth, width=width, height_floor=height_floor, height_roof=height_roof) { n_houses*n_floors*length*width*1300*(1+0.1*height_floor)*(1+0.1*height_roof); }
output_total_cost = Watch(total_cost)  # graph output
MKI = CodeBlock(n_houses=number_of_houses, n_floors=number_of_floors, length=depth, width=width, height_floor=height_floor, height_roof=height_roof) { n_houses*n_floors*length*width*763*(1+0.1*height_floor)*(1+0.1*height_roof); }
output_mki = Watch(MKI)  # graph output
MKI_2 = CodeBlock(n_houses=number_of_houses, n_floors=number_of_floors, length=depth, width=width, height_floor=height_floor, height_roof=height_roof) { n_houses*n_floors*length*width*0.015*(1+0.1*height_floor)*(1+0.1*height_roof); }
output_co2 = Watch(MKI_2)  # graph output
XY = Plane.XY()
byWidthLength = Rectangle.ByWidthLength(plane=XY, width=width, length=depth)
height_floors_list = CodeBlock(n_floors=total_height, height_floor=height_floor) { 0..n_floors..height_floor; }
translate_13 = Geometry.Translate(geometry=byWidthLength, zTranslation=height_floors_list)
list_create = List.Create(item0=byWidthLength, item1=translate_13)
flatten = List.Flatten(list=list_create)
cycle_3 = List.Cycle(list=flatten, amount=number_of_houses)
code_block_4 = CodeBlock(n=number_of_floors) { n+2; }
chop_3 = List.Chop(list=cycle_3, lengths=code_block_4)
code_block_5 = CodeBlock(n_houses=number_of_houses, width=width) { 0..n_houses*width..width; }
translate_14 = Geometry.Translate(geometry=chop_3, xTranslation=code_block_5)
byPatch = Surface.ByPatch(closedCurve=translate_14)
roof_back = CodeBlock(width=width, depth=depth, total_height=total_height, height_roof=height_roof)
# ---------- roof_back.designscript (3 lines) ----------
x=[-width/2,width/2,width/2,-width/2];
y=[depth/2,depth/2,0,0];
z=[total_height,total_height,total_height+height_roof,total_height+height_roof];
# ----------------------------------------
byCoordinates_11 = Point.ByCoordinates(x=roof_back.x, y=roof_back.y, z=roof_back.z)
byCornerPoints_4 = Rectangle.ByCornerPoints(points=byCoordinates_11)
byPatch_2 = Surface.ByPatch(closedCurve=byCornerPoints_4)
number = DoubleInput(0.001)
thicken = Surface.Thicken(surface=byPatch_2, thickness=number)
translate_15 = Geometry.Translate(geometry=thicken, xTranslation=code_block)
code_block_6 = CodeBlock { red=255; green=51; blue=0; }
byARGB = Color.ByARGB(red=code_block_6.red, green=code_block_6.green, blue=code_block_6.blue)
byGeometryColor = Modifiers.GeometryColor.ByGeometryColor(geometry=translate_15, color=byARGB)
roof_front = CodeBlock(width=width, depth=depth, total_height=total_height, height_roof=height_roof)
# ---------- roof_front.designscript (3 lines) ----------
x=[width/2,-width/2,-width/2,width/2];
y=[-depth/2,-depth/2,0,0];
z=[total_height,total_height,total_height+height_roof,total_height+height_roof];
# ----------------------------------------
byCoordinates_12 = Point.ByCoordinates(x=roof_front.x, y=roof_front.y, z=roof_front.z)
byCornerPoints_5 = Rectangle.ByCornerPoints(points=byCoordinates_12)
byPatch_3 = Surface.ByPatch(closedCurve=byCornerPoints_5)
thicken_2 = Surface.Thicken(surface=byPatch_3, thickness=number)
translate_16 = Geometry.Translate(geometry=thicken_2, xTranslation=code_block)
byGeometryColor_2 = Modifiers.GeometryColor.ByGeometryColor(geometry=translate_16, color=byARGB)
roof_closure_left_end_side = CodeBlock(width=width, depth=depth, total_height=total_height, height_roof=height_roof) { x=[-width/2,-width/2,-width/2]; y=[depth/2,0,-depth/2]; z=[total_height,total_height+height_roof,total_height]; }
byCoordinates_13 = Point.ByCoordinates(x=roof_closure_left_end_side.x, y=roof_closure_left_end_side.y, z=roof_closure_left_end_side.z)
byPoints_4 = Polygon.ByPoints(points=byCoordinates_13)
byPatch_4 = Surface.ByPatch(closedCurve=byPoints_4)
thicken_3 = Surface.Thicken(surface=byPatch_4, thickness=number)
translate_17 = Geometry.Translate(geometry=thicken_3, xTranslation=code_block)
byGeometryColor_3 = Modifiers.GeometryColor.ByGeometryColor(geometry=translate_17, color=byARGB)
roof_closure_right_end_side = CodeBlock(width=width, depth=depth, total_height=total_height, height_roof=height_roof) { x=[width/2,width/2,width/2]; y=[depth/2,0,-depth/2]; z=[total_height,total_height+height_roof,total_height]; }
byCoordinates_14 = Point.ByCoordinates(x=roof_closure_right_end_side.x, y=roof_closure_right_end_side.y, z=roof_closure_right_end_side.z)
byPoints_5 = Polygon.ByPoints(points=byCoordinates_14)
byPatch_5 = Surface.ByPatch(closedCurve=byPoints_5)
thicken_4 = Surface.Thicken(surface=byPatch_5, thickness=number)
translate_18 = Geometry.Translate(geometry=thicken_4, xTranslation=code_block)
byGeometryColor_4 = Modifiers.GeometryColor.ByGeometryColor(geometry=translate_18, color=byARGB)
byRuledLoft = Solid.ByRuledLoft(crossSections=translate_14)
code_block_7 = CodeBlock { red=204; green=255; blue=204; }
byARGB_2 = Color.ByARGB(red=code_block_7.red, green=code_block_7.green, blue=code_block_7.blue)
byGeometryColor_5 = Modifiers.GeometryColor.ByGeometryColor(geometry=byRuledLoft, color=byARGB_2)
front_window_1 = CodeBlock(n_floors=number_of_floors, depth=depth, height_floor=height_floor)
# ---------- front_window_1.designscript (3 lines) ----------
x=(n_floors-1)/(n_floors-1)*[-1.5,-1.5,-0.5,-0.5];
y=(n_floors-1)/(n_floors-1)*[depth/2,depth/2,depth/2,depth/2];
z=(n_floors-1)/(n_floors-1)*height_floor+[height_floor/1.5,height_floor/3.5,height_floor/3.5,height_floor/1.5];
# ----------------------------------------
byCoordinates_15 = Point.ByCoordinates(x=front_window_1.x, y=front_window_1.y, z=front_window_1.z)
byCornerPoints_6 = Rectangle.ByCornerPoints(points=byCoordinates_15)
code_block_8 = CodeBlock(number_of_floors=number_of_floors, height_floor=height_floor) { 0..(number_of_floors-2)*height_floor..height_floor; }
translate_19 = Geometry.Translate(geometry=byCornerPoints_6, zTranslation=code_block_8)
cycle_4 = List.Cycle(list=translate_19, amount=number_of_houses)
number_of_windows_3 = CodeBlock(n=number_of_floors) { n-1; }
chop_4 = List.Chop(list=cycle_4, lengths=number_of_windows_3)
translate_20 = Geometry.Translate(geometry=chop_4, xTranslation=code_block)
front_window_2 = CodeBlock(n_floors=number_of_floors, depth=depth, height_floor=height_floor)
# ---------- front_window_2.designscript (3 lines) ----------
x=(n_floors-1)/(n_floors-1)*[1.5,1.5,0.5,0.5];
y=(n_floors-1)/(n_floors-1)*[depth/2,depth/2,depth/2,depth/2];
z=(n_floors-1)/(n_floors-1)*height_floor+[height_floor/1.5,height_floor/3.5,height_floor/3.5,height_floor/1.5];
# ----------------------------------------
byCoordinates_16 = Point.ByCoordinates(x=front_window_2.x, y=front_window_2.y, z=front_window_2.z)
byCornerPoints_7 = Rectangle.ByCornerPoints(points=byCoordinates_16)
code_block_9 = CodeBlock(number_of_floors=number_of_floors, height_floor=height_floor) { 0..(number_of_floors-2)*height_floor..height_floor; }
translate_21 = Geometry.Translate(geometry=byCornerPoints_7, zTranslation=code_block_9)
cycle_5 = List.Cycle(list=translate_21, amount=number_of_houses)
number_of_windows_4 = CodeBlock(n=number_of_floors) { n-1; }
chop_5 = List.Chop(list=cycle_5, lengths=number_of_windows_4)
translate_22 = Geometry.Translate(geometry=chop_5, xTranslation=code_block)
